# Grasshopper definition 0522_to python.gh (Grasshopper 1.0.7)
# plug-ins: Heteroptera

thickness = Slider(7, range=0..10)
thickness_nozzle = Slider(3, range=0..10)

max1 = Slider(5, range=0..10)
ghpython_script = GhPythonScript(
    tileSize=Slider(200, range=0..1000),
    tileHeight=Slider(100, range=0..200),
    tileDepth=Slider(50, range=0..100),
    T1=Slider(5, range=0..10),
    max1=max1,
    T2=Slider(7, range=0..10),
    max2=Slider(8, range=0..10),
    height_nozzle=thickness_nozzle)  # -> out, points1, curve1, points2, translated_curve2, lofted_surface, tween_curves, frame_atbeginn2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
# ---------- ghpython_script: Python ----------
import rhinoscriptsyntax as rs
import Rhino.Geometry as rg
import math
#nozzle
# Curve1
# Define start, step, and stop values
start = 0
step = math.pi / 3
stop = tileSize

# Generate the series using a list comprehension
series_x1 = [start + i * step for i in range(int((stop-start)/step))]
series_y1 = [-max1 * math.sin(x / T1) for x in series_x1]

#point list
points1 = []
for i in range(len(series_x1)):
    x = series_x1[i]
    y = series_y1[i]
    point1 = rg.Point3d(x, y, 0)  # Create a Point object
    points1.append(point1)

#point list to curve
curve1 = rg.PolylineCurve(points1)


# Curve2
# Define start, step, and stop values
start = 0
step = math.pi / 3
stop = tileSize

# Generate the series using a list comprehension
series_x2 = [start + i * step for i in range(int((stop-start)/step))]
series_y2 = [-max2 * math.sin(x / T2) for x in series_x2]

#point list
points2 = []
for i in range(len(series_x2)):
    x = series_x2[i]
    y = series_y2[i]
    point2 = rg.Point3d(x, y, 0)  # Create a Point object
    points2.append(point2)

#point list to curve
curve2 = rg.PolylineCurve(points2)

# Define the translation vector
translation_vector1 = rg.Vector3d(0, 0, tileHeight)  # Replace distance_to_move with the desired value
translation_vector2 = rg.Vector3d(0, 0, height_nozzle) 

# Translate the polyline curve along the Z-axis
curve2.Translate(translation_vector1)
translated_curve2 = curve2


# Create a list of curves to loft
curves = [curve1, translated_curve2]
# Create loft options
loft_type = rg.LoftType.Normal
refit = False
# Create the lofted surface
lofted_surface = rg.Brep.CreateFromLoft(curves, rg.Point3d.Unset, rg.Point3d.Unset, loft_type, refit)



outline_curve = rg.Curve.JoinCurves(lofted_surface[0].DuplicateEdgeCurves(True))
# Join the outline curves
joined_outline_curve = rg.Curve.JoinCurves(outline_curve)

# Create a world YZ plane
plane = rg.Plane.WorldZX
# Project the outline curves onto the plane
projected_curves = []
for curve_id in outline_curve:
    curve = rs.coercecurve(curve_id)
    projected_curve = curve.Duplicate()
    projected_curve.Transform(rg.Transform.PlanarProjection(plane))
    projected_curves.append(projected_curve)

# Define the translation vector
translation_vector = rg.Vector3d(0, tileDepth, 0)  # Adjust the values as per your desired displacement

# Move the projected curves along the X-axis
translated_curves = []
for curve in projected_curves:
    translated_curve = curve.Duplicate()
    translated_curve.Translate(translation_vector)
    translated_curves.append(translated_curve)
# Join the translated curves
joined_curve = rg.Curve.JoinCurves(translated_curves)
boundary_surface = rs.AddPlanarSrf(joined_curve)

#AddSrfBoundary(joined_curve)


num_tween_curves = tileSize / height_nozzle
# Create the tween curves
tween_curves = rg.Curve.CreateTweenCurves(curve1,translated_curve2 , num_tween_curves)

# Create a list of curves to loft
curves_surround = [joined_curve, joined_outline_curve]


c = type(max2)
# ---------- end ghpython_script ----------

flow = Flow(ReverseBase=False, ReverseTarget=False, Stretch=True, Rigid=False)

# ----
# Put all surface together to a brep
surface = Surface(ghpython_script.boundary_surface)
merge = Merge(Data1=ghpython_script.joined_outline_curve, Data2=ghpython_script.joined_curve)
loft = Loft(Curves=merge, Options={Adjust=False, Closed=False, LoftEnds=0, LoftSimp=0, LoftType=0, Rebuild=10, Refit=0.01})
geometry = Geometry(ghpython_script.lofted_surface)
merge_2 = Merge(Data1=geometry, Data2=loft, Data3=surface)
brep_join = BrepJoin(Breps=merge_2)  # -> Breps, Closed

# ----
# contour and make a printable path(out)
unit_z = UnitZ(Factor=1)
contour = Contour(Shape=brep_join.Breps, Point="{0,0,1}", Direction=unit_z, Distance=thickness_nozzle)
divide_curve = DivideCurve(Curve=contour, Count=Slider(200, range=0..1000), Kinks=False)  # -> flatten(Points), Tangents, Parameters
# get inside structure lines(in)
polyline = PolyLine(Vertices=divide_curve.Points, Closed=False)

# ----
# offset inside
subtraction = Subtraction(A=0, B=thickness)
list_item = ListItem(List=contour, Index=0, Wrap=True)
list_item_2 = ListItem(List=flatten(contour), Index=expr("-1", 0), Wrap=True)
offset_curve = OffsetCurve(Curve=graft(contour), Distance=subtraction, Plane=PlaneXY(0, 0, 0), Corners=1)
offset_curve_2 = OffsetCurve(Curve=list_item_2, Distance=subtraction, Plane=PlaneXY(0, 0, 0), Corners=1)

ghpython_script_2 = GhPythonScript(tween_curves=ghpython_script.tween_curves, thickness_nozzle=thickness_nozzle)  # -> out, frame_atbeginn, line, ellipse_polyline, tween_curve1, a; inputs tween_curves: list of Curve
# ---------- ghpython_script_2: Python ----------
import rhinoscriptsyntax as rs
import Rhino.Geometry as rg
import math
#create the section of curves
frame = tween_curves[-1].FrameAt(0)#plan at the beginning, result is one boolean and a plane
frame_atbeginn = frame[1] #delete the boolean
tween_curve1 = tween_curves[-1]
#rotate it
#x_component = frame_atbeginn.XAxis
#y_component = frame_atbeginn.YAxis
#z_component = frame_atbeginn.ZAxis
#origin_point = frame_atbeginn.Origin
#frame_atbeginn2 = rg.Plane(origin_point, y_component, z_component)


#create a ellipse

ellipse = rg.Ellipse(frame_atbeginn, thickness_nozzle/2, 3.5)

rotation_angle = 90.0  # Angle of rotation in degrees
rotation_angle_rad = math.radians(rotation_angle)
# Create a rotation axis along the X-axis
rotation_axis = frame_atbeginn.YAxis
rotation_transform = rg.Transform.Rotation(rotation_angle_rad, rotation_axis, frame_atbeginn.Origin)# Convert the rotation angle to radians
ellipse_curve = ellipse.ToNurbsCurve().Duplicate()
ellipse_curve.Transform(rotation_transform)
ellipse_polyline =ellipse_curve.ToPolyline(0.01, 0.1, 0, 0)
#polyline = rs.AddEllipse(frame_atbeginn2, 3.5,thickness_nozzle/2)
#a stright line
start_point = tween_curves[-1].PointAtStart
end_point = tween_curves[-1].PointAtEnd
line = rs.AddLine(start_point, end_point)
line_curve = rs.coercecurve(line)  # Convert the line into a Rhino curve object
#rail_curve = rs.coercecurve(tween_curves[-1])
#rail_curve_guid = rs.coerceguid(rail_curve)
## 执行扫掠操作
#sections = [section]  # 将单个截面转换为列表

#sweep = rg.LineCurve(line_curve)
#swept_geometry = rs.AddSweep1(line_curve, ellipse_polyline, True)


#rg.Curve.s
#swept_geometry = rg.SweepOneRail(
#swept_geometry = rg.Curve.CreateSweep(ellipse, sweep)
#a = swept_geometry
# ---------- end ghpython_script_2 ----------
plane = Plane(ghpython_script_2.frame_atbeginn)
curve = Curve(ghpython_script_2.tween_curve1)
geometry_2 = Geometry(ghpython_script_2.ellipse_polyline)
geometry_3 = Geometry(ghpython_script_2.a)
panel = Panel(plane)
sweep1 = Sweep1(Rail=curve, Sections=geometry_2, Miter=1)  # disabled

density_of_structure = Slider(10, range=0..50)
divide_curve_2 = DivideCurve(Curve=offset_curve_2, Count=density_of_structure, Kinks=False)  # -> flatten(Points), Tangents, Parameters
divide_curve_3 = DivideCurve(Curve=offset_curve, Count=density_of_structure, Kinks=False)  # -> Points, Tangents, Parameters
deconstruct = Deconstruct(Point=divide_curve_3.Points)  # -> XComponent, YComponent, ZComponent
cull_pattern = CullPattern(List=divide_curve_3.Points, CullPattern=[True, False])
# 所有的line都有了还要再理一下逻辑把他们连起来
cull_pattern_2 = CullPattern(List=divide_curve_3.Points, CullPattern=[False, True])
ghpython_script_3 = GhPythonScript()  # -> out, a; unedited script template
point = Point(cull_pattern_2)
point_2 = Point(cull_pattern)

# ----
# max y value
multiplication = Multiplication(A=max1, B=2)
addition = Addition(A=multiplication, B=thickness)

smaller_than = SmallerThan(FirstNumber=deconstruct.YComponent, SecondNumber=addition)  # -> SmallerThan, OrEqualTo
min_max = MinMax(Number=deconstruct.YComponent)  # -> Minimum, Maximum
panel_2 = Panel(deconstruct.YComponent)
division = Division(B=2)
cull_pattern_3 = CullPattern(List=divide_curve_3.Points, CullPattern=smaller_than.SmallerThan)
polyline_2 = PolyLine(Vertices=cull_pattern_3, Closed=False)
panel_3 = Panel(cull_pattern_3)
explode = Explode(Curve=polyline_2, Recursive=True)  # -> Segments, Vertices
curve_middle = CurveMiddle(Curve=explode.Segments)
deconstruct_2 = Deconstruct(Point=curve_middle)  # -> XComponent, YComponent, ZComponent
construct_point = ConstructPoint(XCoordinate=deconstruct_2.XComponent, YCoordinate=min_max.Maximum, ZCoordinate=deconstruct_2.ZComponent)
weave = Weave(Pattern=[0, 1], Stream0=cull_pattern_3, Stream1=construct_point, NullGaps=False)
polyline_3 = PolyLine(Vertices=weave, Closed=False)

merge_3 = Merge(Data1=construct_point, Data2=cull_pattern_3)
