# Grasshopper definition 0705_fabrication.gh (Grasshopper 1.0.7)

tile_size_y = Slider(100, range=0..1000)
rib_number_01 = Slider(6, range=0..10)
rib_number_02 = Slider(10, range=0..10)
tile_size_z = Slider(400, range=0..1000)
# Ribs
tile_size_x = Slider(400, range=0..1000)
depth02 = Slider(20, range=0..100)
nozzle_height = Slider(3, range=0..100)
depth01 = Slider(20, range=0..100)
cluster = Cluster(
    x_coordinate_2=tile_size_x,
    count_2=rib_number_01,
    x_coordinate=tile_size_x,
    count=rib_number_02,
    factor_3=tile_size_z,
    factor=depth01,
    factor_2=depth02,
    A=tile_size_z,
    B=nozzle_height,
    tile_thickness=Slider(50, range=0..100),
    distance=Slider(6, range=0..10))  # -> loft_2, points1, halftween, curves, offsetcurves
curve = Curve(cluster.halftween)
point = Point(cluster.points1)
surface = Surface(cluster.loft_2)
# path2_insidePolylines
number_slider = Slider(50, range=0..100)
# path1_curves
division = Slider(30, range=0..100)

# ----
# get x value and mid value
ghpython_script = GhPythonScript(points=point)  # -> out, x_values, mid_numbers; inputs points: list of Point3d
# ---------- ghpython_script: Python ----------
import Rhino.Geometry as rg
x_values = [point.X for point in points]  # Extract the X-coordinates from the points list

mid_numbers = []
for i in range(len(x_values) - 1):
    mid_number = (x_values[i] + x_values[i+1]) / 2.0  # Calculate the average of consecutive x-values
    mid_numbers.append(mid_number)

a = mid_numbers
# ---------- end ghpython_script ----------

ghpython_script_2 = GhPythonScript(curves=cluster.halftween, points=point, tile_thickness=number_slider, distance=Slider(6, range=0..10))  # -> out, points1Tree, points2Tree, x_values, mid_numbers; inputs curves: list of Curve, points: list of Point3d
# ---------- ghpython_script_2: Python ----------
import Rhino.Geometry as rg
import ghpythonlib.treehelpers as th

x_values = [point.X for point in points]  # Extract the X-coordinates from the points list

mid_numbers = []
for i in range(len(x_values) - 1):
    mid_number = (x_values[i] + x_values[i+1]) / 2.0  # Calculate the average of consecutive x-values
    mid_numbers.append(mid_number)

points1=[]
points2=[]
for curve in curves:
    point2 =rg.Point3d(curve.PointAtEnd.X, tile_thickness,curve.PointAtEnd.Z)
    point1 =rg.Point3d(curve.PointAtStart.X, tile_thickness,curve.PointAtStart.Z)
#    rg.Point3d(rg.Curve.PointAt(curve,1.0).X,tile_thickness,rg.Curve.PointAt(curve,1.0).Z)

    points1.append([point1])
    points2.append([point2])
points1Tree= th.list_to_tree(points1)
points2Tree= th.list_to_tree(points2)
# ---------- end ghpython_script_2 ----------
# path3_backsidePolylines
number_slider_2 = Slider(5, range=0..10)
curve_2 = Curve(cluster.curves)
horizontal_frames = HorizontalFrames(Curve=cluster.halftween, Count=Slider(30, range=0..100))  # -> Frames, Parameters
ghpython_script_3 = GhPythonScript(
    points1=simplify(ghpython_script_2.points1Tree),
    points2=simplify(ghpython_script_2.points2Tree),
    mid_numbers=simplify(ghpython_script_2.mid_numbers),
    distance=Slider(6, range=0..10))  # -> linePoints; inputs points1: list of Point3d, points2: list of Point3d, mid_numbers: list
# ---------- ghpython_script_3: Python ----------
import Rhino.Geometry as rg

# Create an empty list to store the points with the same x-value
linePoints = []
lines = []
lines2 = []


# Iterate over each point combination from points1 and points2
for point1 in points1:
    transform1 = rg.Transform.Translation(-distance,-distance,0)
    rg.Point3d.Transform(point1,transform1)
    for point2 in points2:
        transform2= rg.Transform.Translation(distance,-distance,0)
        rg.Point3d.Transform(point2,transform2)
        line2 = rg.Line(point1, point2)
        lines2.append(line2)


# Iterate over each line in lines2
for line2 in lines2:
    # Iterate over each x-value
    for x in mid_numbers:
        # Create line start and end points using the desired x-value and line2's start and end Z-coordinates
        start_point = rg.Point3d(x, 0, line2.PointAt(0).Z)
        end_point = rg.Point3d(x, 200, line2.PointAt(1).Z)
        # Create the line
        line = rg.Line(start_point, end_point)
        lines.append(line)
        # Check if line2 intersects with line
        intersects = rg.Intersect.Intersection.LineLine(line, line2)
        t = rg.Intersect.Intersection.LineLine(line2, line)[1]
        # Calculate the intersection point using the parameter
        intersection_point = line2.PointAt(t)
        # Append the intersection point to the points list
        linePoints.append(intersection_point)

a = linePoints
# ---------- end ghpython_script_3 ----------
ghpython_script_4 = GhPythonScript(curves=curve_2, offsetCurves=cluster.offsetcurves, x_values=ghpython_script_2.x_values)  # -> out, curvePoints, a; inputs curves: list of GeometryBase, offsetCurves: list of GeometryBase, x_values: list
# ---------- ghpython_script_4: Python ----------
import Rhino.Geometry as rg

# Create an empty list to store the points with the same x-value
curvePoints = []
lines = []
curveSegments = []
offsetCurveSegments = []

for offsetCurve in offsetCurves:
    offsetCurveSegment = offsetCurve.Explode()[1]
    offsetCurveSegments.append(offsetCurveSegment)

    
# Iterate over each curve
for curve, offsetCurveSegment in zip(curves, offsetCurveSegments):
#    curvePoints.append(curve.Explode()[0].PointAtEnd)
    # Iterate over each x-value
    for x in x_values:
        line = rg.Line(x,0,offsetCurveSegment.PointAtEnd.Z,x , 200,offsetCurveSegment.PointAtEnd.Z)
        lines.append(line)
        # Find the intersection points between the curve and line
        intersection_events = rg.Intersect.Intersection.CurveLine(offsetCurveSegment, line, 0.0, 0.0)
        
        
        # Iterate over each intersection event
        for event in intersection_events:
            if event.IsPoint:
                curvePoints.append(event.PointA)
#    curvePoints.append(curve.Explode()[0].PointAtStart)
# ---------- end ghpython_script_4 ----------
ghpython_script_5 = GhPythonScript(finalFrontLines=graft(cluster.halftween), thickness_tile=Slider(50, range=0..100))  # -> out, a; inputs finalFrontLines: list of Curve; disabled
# ---------- ghpython_script_5: Python ----------
import rhinoscriptsyntax as rs
import Rhino.Geometry as rg
import ghpythonlib.components as gh

finalBackLines = []

for curve in finalFrontLines:
    vector = rg.Vector3d(0, 1, 0)
    vector2 = rg.Vector3d(0, 0, 1)

    startPoint = curve.PointAtStart
    startPoint.X
    secondPoint = rg.Point3d(startPoint.X, thickness_tile, startPoint.Z)

    endPoint = curve.PointAtEnd
    thirdPoint = rg.Point3d(endPoint.X, thickness_tile, endPoint.Z)

    finalBackLine = rg.Polyline([startPoint, secondPoint, thirdPoint, endPoint])
    finalBackLines.append(finalBackLine)


finalLines=[]
for finalFrontLine,finalBackLine in zip(finalFrontLines,finalBackLines):
    finalLine= gh.JoinCurves([finalBackLine, finalFrontLine],False)
    finalLines.append(finalLine)
a = finalLine
# ---------- end ghpython_script_5 ----------
panel = Panel(curve_2)

# ----
# keep x axis and y axis same xy
ghpython_script_6 = GhPythonScript(frames=horizontal_frames.Frames)  # -> out, a, points; inputs frames: list
# ---------- ghpython_script_6: Python ----------
import Rhino.Geometry as rg

# Assuming you have a list of frames stored in the 'frames' variable


# Iterate over the frames
for frame in frames:
    # Get the origin point of the frame
    origin = frame.Origin
    
    # Define the new x-axis and y-axis vectors based on the world xy
    x_axis = rg.Vector3d.XAxis
    y_axis = rg.Vector3d.YAxis
    
    # Update the frame's x-axis and y-axis vectors
    frame.XAxis = x_axis
    frame.YAxis = y_axis
    
    # Set the origin point back to the frame
    frame.Origin = origin
a=frames

# Create an empty list to store the points with the minimum and maximum y values
points = []

# Initialize min_y and max_y with very large and very small values, respectively
min_y = float("inf")
max_y = float("-inf")

# Iterate over each frame
for frame in frames:
    # Access the origin point of the current frame
    origin = frame.Origin
    
    # Check if the current point has a lower y value than min_y
    if origin.Y < min_y:
        min_y = origin.Y
        # Clear the points list since we found a new minimum y value
        points = []
    
    # Check if the current point has a higher y value than max_y
    if origin.Y > max_y:
        max_y = origin.Y
        # Clear the points list since we found a new maximum y value
        points = []
    
    # If the current point has the same y value as min_y or max_y, append it to the points list
    if origin.Y == min_y or origin.Y == max_y:
        points.append(origin)
# ---------- end ghpython_script_6 ----------

ghpython_script_7 = GhPythonScript(
    curves=simplify(curve_2),
    offsetCurves=simplify(cluster.offsetcurves),
    tile_thickness=number_slider,
    ascent_distance=number_slider_2)  # -> simplify(polylinePoints), simplify(points01), simplify(points02), ascentPoints01, ascentPoints02; inputs curves: list of GeometryBase, offsetCurves: list of GeometryBase
# ---------- ghpython_script_7: Python ----------
import Rhino.Geometry as rg
import ghpythonlib.treehelpers as th
import ghpythonlib.components as gh

# Create an empty list to store the points with the same x-value
polylinePoints = []
lines = []
curveSegments = []
points01 = []
points02 = []
ascentPoints01 = []
ascentPoints02 = []
filtered_ascentPoints01 = []
filtered_ascentPoints02 = []
filtered_filtered_ascentPoints01 = []

for curve in curves:
    point01 = curve.Explode()[0].PointAtStart
    point02 = curve.Explode()[0].PointAtEnd
    point03 = rg.Point3d(point01.X,tile_thickness,point01.Z)
    point04 = rg.Point3d(point02.X,tile_thickness,point02.Z)
    ascentPoint01 = point01 + rg.Vector3d(0,ascent_distance,0)
    ascentPoint02 = point02 + rg.Vector3d(0,ascent_distance,0)
    polylinePoints.append(point03)
    polylinePoints.append(point04)
    points01.append(point01)
    points02.append(point02)
    ascentPoints01.append(ascentPoint01)
    ascentPoints02.append(ascentPoint02)
##
#for index, ascentPoint01 in enumerate(ascentPoints01):
#    if index % 2 == 0:
#        filtered_ascentPoints01.append(ascentPoint01)
#for index, ascentPoint02 in enumerate(ascentPoints02):
#    if index % 2 != 0:
#        filtered_ascentPoints02.append(ascentPoint02)
##filtered_ascentPoints01 = gh.FlattenTree(ascentPoints01,{0})
##filtered_filtered_ascentPoints01 = gh.FlattenTree(filtered_ascentPoints01,{0})
#a = filtered_ascentPoints01
# ---------- end ghpython_script_7 ----------
ghpython_script_8 = GhPythonScript(ascentPoints01=flatten(ghpython_script_7.ascentPoints01), ascentPoints02=flatten(ghpython_script_7.ascentPoints02))  # -> filtered_ascentPoints01, filtered_ascentPoints02, a, b; inputs ascentPoints01: list, ascentPoints02: list
# ---------- ghpython_script_8: Python ----------
import Rhino.Geometry as rg

filtered_ascentPoints01=[]
filtered_ascentPoints02=[]

for index, ascentPoint01 in enumerate(ascentPoints01):
    if index % 2 == 0:
        filtered_ascentPoints01.append(ascentPoint01)
for index, ascentPoint02 in enumerate(ascentPoints02):
    if index % 2 != 0:
        filtered_ascentPoints02.append(ascentPoint02)
#filtered_ascentPoints01 = gh.FlattenTree(ascentPoints01,{0})
#filtered_filtered_ascentPoints01 = gh.FlattenTree(filtered_ascentPoints01,{0})
a = filtered_ascentPoints01
b = filtered_ascentPoints02
# ---------- end ghpython_script_8 ----------
ghpython_script_9 = GhPythonScript(
    curves=simplify(curve_2),
    offsetCurves=simplify(cluster.offsetcurves),
    tile_thickness=number_slider,
    ascent_distance=number_slider_2)  # -> simplify(polylinePoints), simplify(points01), simplify(points02), graft(filtered_ascentPoints01), filtered_ascentPoints02, a; inputs curves: tree of GeometryBase, offsetCurves: list of GeometryBase
# ---------- ghpython_script_9: Python ----------
import Rhino.Geometry as rg
import ghpythonlib.treehelpers as th
import ghpythonlib.components as gh
import itertools
# Create an empty list to store the points with the same x-value
polylinePoints = []
lines = []
curveSegments = []
points01 = []
points02 = []
ascentPoints01 = []
ascentPoints02 = []
filtered_ascentPoints01 = []
filtered_ascentPoints02 = []
filtered_filtered_ascentPoints01 = []

flattened_tree = gh.FlattenTree(curves,{0})

for curve in flattened_tree:
    point01 = curve.Explode()[0].PointAtStart
    point02 = curve.Explode()[0].PointAtEnd
    point03 = rg.Point3d(point01.X,tile_thickness,point01.Z)
    point04 = rg.Point3d(point02.X,tile_thickness,point02.Z)
    ascentPoint01 = point01 + rg.Vector3d(0,ascent_distance,0)
    ascentPoint02 = point02 + rg.Vector3d(0,ascent_distance,0)
    polylinePoints.append(point03)
    polylinePoints.append(point04)
    points01.append(point01)
    points02.append(point02)
    ascentPoints01.append(ascentPoint01)
    ascentPoints02.append(ascentPoint02)
#
for index, ascentPoint01 in enumerate(ascentPoints01):
    if index % 2 == 0:
        filtered_ascentPoints01.append(ascentPoint01)
for index, ascentPoint02 in enumerate(ascentPoints02):
    if index % 2 != 0:
        filtered_ascentPoints02.append(ascentPoint02)
#filtered_ascentPoints01 = gh.FlattenTree(ascentPoints01,{0})
#filtered_filtered_ascentPoints01 = gh.FlattenTree(filtered_ascentPoints01,{0})


#a =  th.tree_from_data([])
#for item in filtered_ascentPoints01:
#    tree.Add(item)
# ---------- end ghpython_script_9 ----------
ghpython_script_10 = GhPythonScript(linePoints=ghpython_script_3, curvePoints=ghpython_script_4.curvePoints)  # -> weaved_list, simplify(weavedPoints); inputs linePoints: list, curvePoints: list
# ---------- ghpython_script_10: Python ----------
weaved_list = []
# Get the lengths of the two input lists
len1 = len(linePoints)
len2 = len(curvePoints)

# Determine the maximum length for iteration
max_len = max(len2, len1)

# Weave the lists together
for i in range(max_len):
    if i < len1:
        weaved_list.append(linePoints[i])
    if i < len2:
        weaved_list.append(curvePoints[i])


weavedPoints = weaved_list
# ---------- end ghpython_script_10 ----------
ghpython_script_11 = GhPythonScript(curves=cluster.halftween, division=division)  # -> simplify(curvePointsTree), a; inputs curves: list of Curve, division: Int32
# ---------- ghpython_script_11: Python ----------
import Rhino.Geometry as rg
import ghpythonlib.treehelpers as th

#import ghpythonlib.components as gh

curvePoints = []
for curve in curves:
    curveDoubles = curve.DivideByCount(division, True)
    sublist = []
    new_sublist=[]
    for double in curveDoubles:
        curvePoint = rg.Curve.PointAt(curve,double)
        sublist.append(curvePoint)
    new_sublist = sublist[1:-1]
    curvePoints.append(list(new_sublist))
curvePointsTree = th.list_to_tree(curvePoints)

#     point = gh.DivideCurve(curve, division,False)[1]
#     print(point)

#    curvePoints.append(point)
#     point = rg.Curve.DivideByCount(curve,division,True,curvePoints)
# ---------- end ghpython_script_11 ----------
point_2 = Point(ghpython_script_7.ascentPoints01)
panel_2 = Panel(point_2)
number_slider_3 = Slider(400, range=0..1000)
number_slider_4 = Slider(50, range=0..100)
panel_3 = Panel("{0}")
param_viewer = ParamViewer(ghpython_script_7.ascentPoints01)
panel_4 = Panel(ghpython_script.mid_numbers)
list_length = ListLength(List=ghpython_script_7.ascentPoints01)
panel_5 = Panel(ghpython_script_9.filtered_ascentPoints01)
point_3 = Point(graft(ghpython_script_8.a))
point_4 = Point(graft(ghpython_script_8.filtered_ascentPoints02))
point_5 = Point(ghpython_script_11.curvePointsTree)
point_6 = Point(ghpython_script_7.points01)
list_item = ListItem(List=ghpython_script_11.curvePointsTree, Index=0, Wrap=True)
list_item_2 = ListItem(List=ghpython_script_10.weavedPoints, Index=0, Wrap=True)
point_7 = Point(ghpython_script_7.points02)
point_8 = Point(ghpython_script_10.weavedPoints)
point_9 = Point(ghpython_script_7.polylinePoints)
point_10 = Point(ghpython_script_6.points)
cluster_2 = Cluster_2(data=point_5)  # -> simplify(data_2), simplify(data_3)
cluster_3 = Cluster_2(data=point_8)  # -> simplify(data_2), simplify(data_3)
cluster_4 = Cluster_2(data=point_9)  # -> simplify(data_2), simplify(data_3)
cluster_5 = Cluster_2(data=ghpython_script_7.ascentPoints01)  # -> simplify(data_2), simplify(data_3)
cluster_6 = Cluster_2(data=point_6)  # -> simplify(data_2), simplify(data_3)
cluster_7 = Cluster_2(data=ghpython_script_7.ascentPoints02)  # -> simplify(data_2), simplify(data_3)
cluster_8 = Cluster_2(data=point_7)  # -> simplify(data_2), simplify(data_3)
reverse_list = ReverseList(List=ghpython_script_6.a)

number_slider_5 = Slider(6, range=0..10)
offset_curve = OffsetCurve(Curve=cluster.halftween, Distance=number_slider_5, Plane=PlaneXY(0, 0, 0), Corners=1)

# ----
# get curve-in points
end_points = EndPoints()  # -> Start, End
ghpython_script_12 = GhPythonScript(curves=offset_curve, x_values=ghpython_script.x_values)  # -> out, points; inputs curves: list of Curve, x_values: list
# ---------- ghpython_script_12: Python ----------
import Rhino.Geometry as rg

# Create an empty list to store the points with the same x-value
points = []
lines = []

# Iterate over each curve
for curve in curves:
#    points.append(rg.Curve.PointAtEnd)
    # Iterate over each x-value
    for x in x_values:
        line = rg.Line(x,0,curve.PointAtEnd.Z,x , 200,curve.PointAtEnd.Z)
        lines.append(line)
        # Find the intersection points between the curve and line
        intersection_events = rg.Intersect.Intersection.CurveLine(curve, line, 0.0, 0.0)
        
        # Iterate over each intersection event
        for event in intersection_events:
            if event.IsPoint:
                # Append the intersection point to the points list
                points.append(event.PointA)
a = points
# ---------- end ghpython_script_12 ----------
list_item_3 = ListItem(List=end_points.Start, Index=0, Wrap=True)
list_item_4 = ListItem(List=end_points.Start, Index=3, Wrap=True)

point_11 = Point(cluster_5.data_3)
point_12 = Point(cluster_7.data_3)
point_13 = Point(cluster_5.data_2)
point_14 = Point(cluster_4.data_2)
point_15 = Point(cluster_2.data_2)
point_16 = Point(cluster_6.data_2)
point_17 = Point(cluster_3.data_2)
point_18 = Point(cluster_6.data_3)
point_19 = Point(cluster_7.data_2)
point_20 = Point(cluster_8.data_2)
point_21 = Point(cluster_8.data_3)
reverse_list_2 = ReverseList(List=point_15)
reverse_list_3 = ReverseList(List=point_14)
point_22 = Point(cluster_4.data_3)
point_23 = Point(cluster_2.data_3)
point_24 = Point(cluster_3.data_3)
reverse_list_4 = ReverseList(List=point_24)

# ----
# Old one(no inside structure
ghpython_script_13 = GhPythonScript(frames=ghpython_script_6.a, tileThickness=number_slider_4, tileWidth=number_slider_3)  # -> out, graft(modified_frames_first), graft(modified_frames_second), simplify(graft(modified_frames_third)), simplify(flatten(last_frame)); inputs frames: tree of Plane, vertices: list of Point3d
# ---------- ghpython_script_13: Python ----------
import ghpythonlib.treehelpers as th
import Rhino.Geometry as rg
import ghpythonlib.components as gh



# Create an empty list to store the modified frames
modified_frames_first = []
modified_frames_second = []
modified_frames_third = [] 

# Iterate over the tree branches (sublists)
for branch in frames.Branches:
    # Get the first frame in the sublist
    first_frame = branch[frames.Branch(0).Count -1 ]
    
    # Create a copy of the first frame
    moved_frame_y = rg.Plane(first_frame)
    
    # Allocate the value 50 to the x-coordinate of moved_frame_y
    moved_frame_y.Origin = rg.Point3d(first_frame.Origin.X, tileThickness, first_frame.Origin.Z)
    
    # Create a new frame by moving the first frame along the x-axis by 400
    moved_frame_x = rg.Plane(moved_frame_y)
    moved_frame_x.Translate(rg.Vector3d(tileWidth, 0, 0))
    
    moved_frame_3 = rg.Plane(moved_frame_y)
    moved_frame_3.Translate(rg.Vector3d(10, 0, 0))
    
    # Append the modified frames to the list
    modified_frames_first.append(moved_frame_y)
    modified_frames_second.append(moved_frame_x)
    modified_frames_third.append(moved_frame_3)


last_frame = modified_frames_first[gh.ListLength(modified_frames_first)-1]
# ---------- end ghpython_script_13 ----------
merge = Merge(
    Data1=simplify(ghpython_script_13.modified_frames_first),
    Data2=simplify(reverse_list),
    Data3=simplify(ghpython_script_13.modified_frames_second),
    Data4=simplify(ghpython_script_13.modified_frames_third))  # -> flatten(Result)
plane = Plane([PlaneXY(0, 50, 0), PlaneXY(0, 20, 0), PlaneXY(12.25720171, 13.09448445, 0), PlaneXY(24.97944778, 7.094225218, 0), PlaneXY(38.25152948, 2.448259366, 0), PlaneXY(52.0509664, -0.211050079, 0)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])
polyline = PolyLine(Vertices=merge, Closed=False)  # disabled

# ----
# get line-in points
point_25 = Point(ghpython_script_13.modified_frames_first)
point_26 = Point(ghpython_script_13.modified_frames_second)
ghpython_script_14 = GhPythonScript(points1=point_26, points2=point_25, x_values=ghpython_script.mid_numbers, distance=number_slider_5)  # -> out, points, a; inputs points1: list of Point3d, points2: list of Point3d, x_values: list
# ---------- ghpython_script_14: Python ----------
import Rhino.Geometry as rg

# Create an empty list to store the points with the same x-value
points = []
lines = []
lines2 = []


# Iterate over each point combination from points1 and points2
for point1 in points1:
    transform1 = rg.Transform.Translation(-distance,-distance,0)
    rg.Point3d.Transform(point1,transform1)
    for point2 in points2:
        transform2= rg.Transform.Translation(distance,-distance,0)
        rg.Point3d.Transform(point2,transform2)
        line2 = rg.Line(point1, point2)
        lines2.append(line2)

# Iterate over each line in lines2
for line2 in lines2:
    # Iterate over each x-value
    for x in x_values:
        # Create line start and end points using the desired x-value and line2's start and end Z-coordinates
        start_point = rg.Point3d(x, 0, line2.PointAt(0).Z)
        end_point = rg.Point3d(x, 200, line2.PointAt(1).Z)
        # Create the line
        line = rg.Line(start_point, end_point)
        lines.append(line)
        
        # Check if line2 intersects with line
        intersects = rg.Intersect.Intersection.LineLine(line2, line)
        
        # If there is an intersection, calculate the intersection point
        if intersects:
            # Calculate the intersection parameter of line2
            t = rg.Intersect.Intersection.LineLine(line2, line)[1]
            
            # Calculate the intersection point using the parameter
            intersection_point = line2.PointAt(t)
            
            # Append the intersection point to the points list
            points.append(intersection_point)
a = t
# ---------- end ghpython_script_14 ----------
point_27 = Point(ghpython_script_14.points)

ghpython_script_15 = GhPythonScript(points1=point_26, points2=point_25, x_values=ghpython_script.mid_numbers, distance=number_slider_5)  # -> out, points, a; inputs points1: list of Point3d, points2: list of Point3d, x_values: list
# ---------- ghpython_script_15: Python ----------
import Rhino.Geometry as rg

# Create an empty list to store the points with the same x-value
points = []
lines = []
lines2 = []


# Iterate over each point combination from points1 and points2
for point1 in points1:
    transform1 = rg.Transform.Translation(-distance,-distance,0)
    rg.Point3d.Transform(point1,transform1)
    for point2 in points2:
        transform2= rg.Transform.Translation(distance,-distance,0)
        rg.Point3d.Transform(point2,transform2)
        line2 = rg.Line(point1, point2)
        lines2.append(line2)

a = lines2
# Iterate over each line in lines2
for line2 in lines2:
    # Iterate over each x-value
    for x in x_values:
        # Create line start and end points using the desired x-value and line2's start and end Z-coordinates
        start_point = rg.Point3d(x, 0, line2.PointAt(0).Z)
        end_point = rg.Point3d(x, 200, line2.PointAt(1).Z)
        # Create the line
        line = rg.Line(start_point, end_point)
        lines.append(line)
        
        # Check if line2 intersects with line
        intersects = rg.Intersect.Intersection.LineLine(line2, line)
        
        # If there is an intersection, calculate the intersection point
        if intersects:
            # Calculate the intersection parameter of line2
            t = rg.Intersect.Intersection.LineLine(line2, line)[1]
            
            # Calculate the intersection point using the parameter
            intersection_point = line2.PointAt(t)
            
            # Append the intersection point to the points list
            points.append(intersection_point)
# ---------- end ghpython_script_15 ----------
panel_8 = Panel(ghpython_script_14.points)
panel_9 = Panel(ghpython_script_14.a)
merge_2 = Merge(
    Data1=point_18,
    Data2=point_22,
    Data3=point_21,
    Data4=point_23,
    Data5=point_18,
    Data6=reverse_list_4,
    Data7=point_21,
    Data8=point_19,
    Data9=reverse_list_3,
    Data10=point_16,
    Data11=reverse_list_2,
    Data12=point_20,
    Data13=point_17,
    Data14=point_16,
    Data15=point_11)  # -> flatten(Result)
merge_3 = Merge(Data1=simplify(list_item_4), Data2=simplify(ghpython_script_12.points), Data3=simplify(list_item_3))
plane_2 = Plane([PlaneXY(0, 20, 0), PlaneXY(0, 50, 0), PlaneXY(400, 50, 0), PlaneXY(400, 20, 0), PlaneXY(387.7427983, 13.09448444, 0), PlaneXY(375.0205546, 7.09422621, 0)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])
weave = Weave(Pattern=[0, 1], Stream0=merge_3, Stream1=point_27, NullGaps=False)  # -> simplify(Weave)
polyline_2 = PolyLine(Vertices=flatten(merge_2), Closed=False)
polyline_3 = PolyLine(Vertices=weave, Closed=False)
scale = Scale(Geometry=plane_2, Center=Point(0, 0, 0), Factor=Slider(0.001, range=0..0.001))  # -> Geometry, Transform
ghpython_script_16 = GhPythonScript(frames=ghpython_script_6.a, tileThickness=number_slider_4, tileWidth=number_slider_3, vertices=weave)  # -> out, graft(modified_frames_first), graft(modified_frames_second), simplify(graft(modified_frames_third)), simplify(flatten(last_frame)), modified_frames_inside; inputs frames: tree of Plane, vertices: list of Point3d
# ---------- ghpython_script_16: Python ----------
import ghpythonlib.treehelpers as th
import Rhino.Geometry as rg
import ghpythonlib.components as gh



# Create an empty list to store the modified frames
modified_frames_first = []
modified_frames_second = []
modified_frames_third = [] 
modified_frames_inside = []


# Iterate over the tree branches (sublists)
for branch in frames.Branches:
    # Get the first frame in the sublist
    first_frame = branch[frames.Branch(0).Count -1 ]
    
    # Create a copy of the first frame
    moved_frame_y = rg.Plane(first_frame)
    
    # Allocate the value 50 to the x-coordinate of moved_frame_y
    moved_frame_y.Origin = rg.Point3d(first_frame.Origin.X, tileThickness, first_frame.Origin.Z)
    
    # Create a new frame by moving the first frame along the x-axis by 400
    moved_frame_x = rg.Plane(moved_frame_y)
    moved_frame_x.Translate(rg.Vector3d(tileWidth, 0, 0))
    
    moved_frame_3 = rg.Plane(moved_frame_y)
    moved_frame_3.Translate(rg.Vector3d(10, 0, 0))
    
    # Append the modified frames to the list
    modified_frames_first.append(moved_frame_y)
    modified_frames_second.append(moved_frame_x)
    modified_frames_third.append(moved_frame_3)

for vertice in vertices:
    frame = rg.Plane(vertice, modified_frames_first[0].XAxis, modified_frames_first[0].YAxis)
    modified_frames_inside.append(frame)

last_frame = modified_frames_first[gh.ListLength(modified_frames_first)-1]
# ---------- end ghpython_script_16 ----------
plane_3 = Plane(ghpython_script_16.modified_frames_first)
plane_4 = Plane(ghpython_script_16.modified_frames_second)
plane_5 = Plane(ghpython_script_16.last_frame)
panel_11 = Panel("hint: list0:")

# ==== cluster Cluster
factor = ClusterInput()
x_coordinate = ClusterInput()
x_coordinate_2 = ClusterInput()
factor_2 = ClusterInput()
unit_y = UnitY(Factor=factor)
unit_y_2 = UnitY(Factor=factor_2)
count = ClusterInput()

construct_point = ConstructPoint(XCoordinate=x_coordinate, YCoordinate=0, ZCoordinate=0)
construct_point_2 = ConstructPoint(XCoordinate=0, YCoordinate=0, ZCoordinate=0)
line = Line(StartPoint=construct_point, EndPoint=construct_point_2)
divide_curve = DivideCurve(Curve=line, Count=count, Kinks=False)  # -> Points, Tangents, Parameters

count_2 = ClusterInput()

construct_point_3 = ConstructPoint(XCoordinate=x_coordinate_2, YCoordinate=0, ZCoordinate=0)
construct_point_4 = ConstructPoint(XCoordinate=0, YCoordinate=0, ZCoordinate=0)
line_2 = Line(StartPoint=construct_point_3, EndPoint=construct_point_4)
divide_curve_2 = DivideCurve(Curve=line_2, Count=count_2, Kinks=False)  # -> Points, Tangents, Parameters
dispatch = Dispatch(List=divide_curve_2.Points, DispatchPattern=[True, False])  # -> ListA, ListB

factor_3 = ClusterInput()

unit_z = UnitZ(Factor=factor_3)
move = Move(Geometry=divide_curve.Points, Motion=unit_z)  # -> Geometry, Transform

move_2 = Move(Geometry=dispatch.ListA, Motion=unit_y)  # -> Geometry, Transform
A = ClusterInput()
B = ClusterInput()
division = Division(A=A, B=B)
dispatch_2 = Dispatch(List=move.Geometry, DispatchPattern=[True, False])  # -> ListA, ListB
weave = Weave(Pattern=[0, 1], Stream0=move_2.Geometry, Stream1=dispatch.ListB, NullGaps=False)
tile_thickness = ClusterInput()
move_3 = Move(Geometry=dispatch_2.ListA, Motion=unit_y_2)  # -> Geometry, Transform

construct_domain = ConstructDomain(DomainStart=0, DomainEnd=1)
range = Range(Domain=construct_domain, Steps=division)

weave_2 = Weave(Pattern=[0, 1], Stream0=move_3.Geometry, Stream1=dispatch_2.ListB, NullGaps=False)
unit_y_3 = UnitY(Factor=tile_thickness)
points1 = ClusterOutput(weave)
interpolate = Interpolate(Vertices=weave, Degree=3, Periodic=False, KnotStyle=1)  # -> Curve, Length, Domain
interpolate_2 = Interpolate(Vertices=weave_2, Degree=3, Periodic=False, KnotStyle=1)  # -> Curve, Length, Domain

merge = Merge(Data1=interpolate.Curve, Data2=interpolate_2.Curve)
loft = Loft(Curves=merge, Options={Adjust=False, Closed=False, LoftEnds=0, LoftSimp=0, LoftType=0, Rebuild=10, Refit=0.01})

tween_curve = TweenCurve(CurveA=interpolate.Curve, CurveB=interpolate_2.Curve, Factor=range, BlendType=0)
loft_2 = ClusterOutput(loft)

# ----
# half design-tile
curve = Curve(tween_curve)
list_length = ListLength(List=curve)
division_2 = Division(A=list_length, B=2)
construct_domain_2 = ConstructDomain(DomainStart=0, DomainEnd=division_2)
sub_list = SubList(List=curve, Domain=construct_domain_2, Wrap=True)  # -> List, Index

end_points = EndPoints(Curve=sub_list.List)  # -> graft(Start), graft(End)
deconstruct = Deconstruct(Point=end_points.Start)  # -> XComponent, YComponent, ZComponent
deconstruct_2 = Deconstruct(Point=end_points.End)  # -> XComponent, YComponent, ZComponent
construct_point_5 = ConstructPoint(XCoordinate=deconstruct.XComponent, YCoordinate=tile_thickness, ZCoordinate=deconstruct.ZComponent)
construct_point_6 = ConstructPoint(XCoordinate=deconstruct_2.XComponent, YCoordinate=tile_thickness, ZCoordinate=deconstruct_2.ZComponent)
merge_2 = Merge(Data1=end_points.End, Data2=construct_point_6, Data3=construct_point_5, Data4=end_points.Start)
polyline = PolyLine(Vertices=merge_2, Closed=Toggle(False))
merge_3 = Merge(Data1=simplify(polyline), Data2=simplify(graft(sub_list.List)))
distance = ClusterInput()
halftween = ClusterOutput(sub_list.List)
join_curves = JoinCurves(Curves=merge_3, Preserve=False)
offset_curve = OffsetCurve(Curve=join_curves, Distance=distance, Plane=PlaneXY(0, 0, 0), Corners=1)
curves = ClusterOutput(join_curves)
offsetcurves = ClusterOutput(offset_curve)

# ==== cluster Cluster_2
data = ClusterInput()
flip_matrix = FlipMatrix(Data=data)

# ----
# 奇数
list_length = ListLength(List=flip_matrix)  # -> flatten(Length)

division = Division(A=list_length, B=2)

list_item = ListItem(List=division, Index=0, Wrap=True)
series = Series(Start=Slider(1, range=0..1), Step=Slider(2, range=0..10), Count=list_item)

list_item_2 = ListItem(List=flip_matrix, Index=series, Wrap=True)
flip_matrix_2 = FlipMatrix(Data=list_item_2)
data_2 = ClusterOutput(flip_matrix_2)

# ----
# 偶数
list_length_2 = ListLength(List=flip_matrix)  # -> flatten(Length)

division_2 = Division(A=list_length_2, B=2)
list_item_3 = ListItem(List=division_2, Index=0, Wrap=True)

series_2 = Series(Start=0, Step=Slider(2, range=0..10), Count=list_item_3)

list_item_4 = ListItem(List=flip_matrix, Index=series_2, Wrap=True)
flip_matrix_3 = FlipMatrix(Data=list_item_4)
data_3 = ClusterOutput(flip_matrix_3)
