# Grasshopper definition 0719_all_in_python.gh (Grasshopper 1.0.7)
# plug-ins: RhinoCodePluginGH

height = Slider(20, range=0..100)
# Vonio
number_slider = Slider(0.5, range=0..1)
# To top Geometry 3
rectangle = Rectangle({Plane=PlaneXY(244.5, -47, 0), Size=Domain2(u=-166.5..166.5, v=-125..125)})
scale = Slider(0.13, range=0..1)
# To top Geometry
radius = Slider(50, range=0..100)
height_2 = Slider(36, range=0..100)
scale_2 = Slider(0.26, range=0..1)
# To top Geometry 2
radius_2 = Slider(50, range=0..100)
# Folds
number_slider_2 = Slider(200, range=0..1000)
# Ribs
number_slider_3 = Slider(0.5, range=0..1)

# ----
# parametric mesh
thickness = Slider(50, range=0..100)
# burp
tile_size = Slider(200, range=0..1000)
divisions = Slider(10, range=0..100)
script = Script(tile_size=tile_size, divisions=divisions, thickness=thickness)  # -> out, a; inputs divisions: Int32
# ---------- script: Python ----------
import Rhino.Geometry as rg
import math

def Burpgeometry(length, width, height, divisions,point):
    # Create a box
    plane = rg.Plane(point,rg.Vector3d(1,0,0),rg.Vector3d(0,1,0))
    box = rg.Box(plane, rg.Interval(0, length), rg.Interval(0, width), rg.Interval(0, height))

    # Get the mesh representation of the box
    mesh = rg.Mesh.CreateFromBox(box, divisions, 1, divisions)
    # vertices = mesh.Vertices
    # front_side_vertices = []
    # back_side_vertices = []
    # # Iterate through each point in the list
    # for vertex in vertices:
    #     # Check if the Y-coordinate of the current point is less than or equal to the separation_y
    #     if vertex.Y == width:
    #         front_side_vertices.append(vertex)
    #     else:
    #         back_side_vertices.append(vertex)
    # unique_vertices_set = set(front_side_vertices)
    # unique_vertices_list = list(unique_vertices_set)
    # square_root = math.sqrt(len(unique_vertices_list))


    # step_x = length / divisions
    # step_z = height / divisions
    # y = point.Y + width

    # vertices_to_move01 = []
    # x_values01=[]
    # z_values01 = []
    # for i in range(1, divisions ,2):
    #     x_values01.append(point.X + i*step_x)
    # for i in range(1, divisions ,2):
    #     z_values01.append(point.Z + i*step_z)
    # for x_value in x_values01:
    #     for z_value in z_values01:
    #          vertices_to_move01.append(rg.Point3d(x_value,y,z_value))

    # vertices_to_move02 = []
    # x_values02=[]
    # z_values02 = []
    # for i in range(2, divisions ,2):
    #     x_values02.append(point.X + i*step_x)
    # for i in range(2, divisions ,2):
    #     z_values02.append(point.Z + i*step_z)
    # for x_value in x_values02:
    #     for z_value in z_values02:
    #          vertices_to_move02.append(rg.Point3d(x_value,y,z_value))
    
    # vertices_to_move=[]
    # # vertices_to_move.extend(vertices_to_move01)
    # # vertices_to_move.extend(vertices_to_move02)
    # for vertex01 in vertices_to_move01:
    #     vertex = rg.Point3f(float(vertex01.X),float(vertex01.Y),float(vertex01.Z))
    #     vertices_to_move.append(vertex)
    # for vertex02 in vertices_to_move02:
    #     vertex = rg.Point3f(float(vertex02.X),float(vertex02.Y),float(vertex02.Z))
    #     vertices_to_move.append(vertex)    


    # new_vertices=[]
    # for vertex in vertices:
    #     # vertex = vertex.ToPoint3d()
    #     if vertex in vertices_to_move:
    #         # Apply deformation to the vertex
    #         deformation = rg.Vector3d(0,20,0)
    #         new_vertex = rg.Point3d(vertex.X + deformation.X, vertex.Y + deformation.Y, vertex.Z + deformation.Z)
    #     else:
    #         # Keep the original vertex
    #         new_vertex = vertex
    #     new_vertices.append(new_vertex)

    # updated_mesh= rg.Mesh()
    # updated_mesh.Vertices.AddVertices(mesh.Vertices)

    # for i in range(updated_mesh.Vertices.Count):
    #     vertex = updated_mesh.Vertices[i]
    #     # Check if the vertex is in the list of vertices to move
    #     if vertex in vertices_to_move:
    #         vertex = rg.Point3d(vertex.X + deformation.X, vertex.Y + deformation.Y, vertex.Z + deformation.Z)
    # #to subd
    # subd = rg.SubD.CreateFromMesh(mesh,rg.SubDCreationOptions())
    # edge_list = subd.Edges

    # # Tag all edges as creases
    # for edge in subd.Edges:
    #     edge.Tag = rg.SubDEdgeTag.Crease

    return mesh

length = height=tile_size
width =thickness
point= rg.Point3d(0,0,0)
# Create the mesh box
a= Burpgeometry(length, width, height, divisions,point)
# ---------- end script ----------

distance_to_move = Slider(67, range=0..100)

# ----
# mesh points move try
number_slider_4 = Slider(200, range=0..1000)
script_2 = Script(tile_size=number_slider_4, divisions=Slider(6, range=0..100), thickness=Slider(50, range=0..100))  # -> out, mesh, updated_mesh; inputs divisions: Int32
# ---------- script_2: Python ----------
import Rhino.Geometry as rg
import math

def Burpgeometry(length, width, height, divisions,point):
    # Create a box
    plane = rg.Plane(point,rg.Vector3d(1,0,0),rg.Vector3d(0,1,0))
    box = rg.Box(plane, rg.Interval(0, length), rg.Interval(0, width), rg.Interval(0, height))

    # Get the mesh representation of the box
    mesh = rg.Mesh.CreateFromBox(box, divisions, 1, divisions)
    vertices = mesh.Vertices
    front_side_vertices = []
    back_side_vertices = []
    # Iterate through each point in the list
    for vertex in vertices:
        # Check if the Y-coordinate of the current point is less than or equal to the separation_y
        if vertex.Y == width:
            front_side_vertices.append(vertex)
        else:
            back_side_vertices.append(vertex)
    unique_vertices_set = set(front_side_vertices)
    unique_vertices_list = list(unique_vertices_set)
    square_root = math.sqrt(len(unique_vertices_list))


    step_x = length / divisions
    step_z = height / divisions
    y = point.Y + width

    vertices_to_move01 = []
    x_values01=[]
    z_values01 = []
    for i in range(1, divisions ,2):
        x_values01.append(point.X + i*step_x)
    for i in range(1, divisions ,2):
        z_values01.append(point.Z + i*step_z)
    for x_value in x_values01:
        for z_value in z_values01:
             vertices_to_move01.append(rg.Point3d(x_value,y,z_value))

    vertices_to_move02 = []
    x_values02=[]
    z_values02 = []
    for i in range(2, divisions ,2):
        x_values02.append(point.X + i*step_x)
    for i in range(2, divisions ,2):
        z_values02.append(point.Z + i*step_z)
    for x_value in x_values02:
        for z_value in z_values02:
             vertices_to_move02.append(rg.Point3d(x_value,y,z_value))
    
    vertices_to_move=[]
    # vertices_to_move.extend(vertices_to_move01)
    # vertices_to_move.extend(vertices_to_move02)
    for vertex01 in vertices_to_move01:
        vertex = rg.Point3f(float(vertex01.X),float(vertex01.Y),float(vertex01.Z))
        vertices_to_move.append(vertex)
    for vertex02 in vertices_to_move02:
        vertex = rg.Point3f(float(vertex02.X),float(vertex02.Y),float(vertex02.Z))
        vertices_to_move.append(vertex)    


    new_vertices=[]
    for vertex in vertices:
        # vertex = vertex.ToPoint3d()
        if vertex in vertices_to_move:
            # Apply deformation to the vertex
            deformation = rg.Vector3d(0,20,0)
            new_vertex = rg.Point3d(vertex.X + deformation.X, vertex.Y + deformation.Y, vertex.Z + deformation.Z)
        else:
            # Keep the original vertex
            new_vertex = vertex
        new_vertices.append(new_vertex)

    # for i in range(mesh.Vertices.Count):
    #     mesh.Vertices[i] = new_vertices[i]
    # mesh.Vertices.Clear()
    # mesh.Vertices.AddVertices(new_vertices)
    a=[]
    updated_mesh= rg.Mesh()
    updated_mesh.Vertices.AddVertices(mesh.Vertices)

    for i in range(updated_mesh.Vertices.Count):
        vertex = updated_mesh.Vertices[i]
        # Check if the vertex is in the list of vertices to move
        if vertex in vertices_to_move:
            vertex = rg.Point3d(vertex.X + deformation.X, vertex.Y + deformation.Y, vertex.Z + deformation.Z)
            a.append(vertex)
        
    return [mesh,updated_mesh]


length = height=tile_size
width =thickness
point= rg.Point3d(1,1,1)
# Create the mesh box
mesh= Burpgeometry(length, width, height, divisions,point)[0]
updated_mesh= Burpgeometry(length, width, height, divisions,point)[1]
# ---------- end script_2 ----------
# contour to get the lines
panel = Panel(script_2.updated_mesh)
panel_2 = Panel(script_2.mesh)

# ----
# nurbsurface version
plane = Script()  # -> out, a
# ---------- plane: Python ----------
import Rhino.Geometry as rg

def Burp_geometry(tile_size):
    planesurface = rg.PlaneSurface(rg.Plane.WorldZX,rg.Interval(0,tile_size),rg.Interval(0,tile_size))
    surface_rebult = planesurface.Rebuild(3,3,10,10)
    nurbs_surface = surface_rebult.ToNurbsSurface()
    control_points = nurbs_surface.Points
    # for control_point in control_points:
    #     control_point.
    points =[control_point.Location for control_point in control_points]
    return points

tile_size =400
a = Burp_geometry(tile_size)
# ---------- end plane ----------

# ----
# gh Voronoi
ghpython_script = GhPythonScript(boundary=rectangle, count=Slider(5, range=0..10))  # -> a, b; inputs boundary: Rectangle3d, plane: list
# ---------- ghpython_script: Python ----------
import Rhino.Geometry as rg
import ghpythonlib.components as gh

#a = gh.Voronoi(points,boundary)
points = gh.Populate2D(boundary,count,5)
a = gh.Voronoi(points,5000,boundary)
# ---------- end ghpython_script ----------

# ----
# parametric mesh
script_3 = Script(radius=radius_2, scale=scale_2, height=height, parameter=number_slider)  # -> out, mesh
# ---------- script_3: Python ----------
import Rhino.Geometry as rg
import ghpythonlib.components as gh


def to_top_geometry(center_point, radius, scale, height, parameter):
    # Create a regular hexagon with the specified center point and radius
    circle = rg.Circle(center_point , radius)
    quadrilateral = rg.Polyline.CreateInscribedPolygon(circle,4)
    points_to_move = []
    points_to_move.append(list(quadrilateral.GetEnumerator())[0])
    points_to_move.append(list(quadrilateral.GetEnumerator())[2])
    distance_to_move = parameter * radius
    for i,point in enumerate(points_to_move):
        if i ==0:
            point.Transform(rg.Transform.Translation(-distance_to_move, 0,0))
        if i !=0:
            point.Transform(rg.Transform.Translation(distance_to_move, 0,0))       
    # #new polyline
    new_points =[]
    new_points.append(points_to_move[0])
    new_points.append(list(quadrilateral.GetEnumerator())[3])
    new_points.append(points_to_move[1])
    new_points.append(list(quadrilateral.GetEnumerator())[1])
    new_points.append(points_to_move[0])
    # new_polyline = quadrilateral
    new_polyline = rg.Polyline(new_points)
    # c = rg.Polyline(new_polyline).ToNurbsCurve()

    #find the center point get upper polyline
    new_polyline_transformed = rg.Polyline.Duplicate(new_polyline)
    center_point = rg.Polyline.CenterPoint(new_polyline)
    new_polyline_transformed.Transform(rg.Transform.Scale(center_point,scale))
    new_polyline_transformed.Transform(rg.Transform.Translation(0,0,height))
    #loft geometry and close it
    curve1 = rg.Polyline(new_polyline).ToNurbsCurve()
    curve2 = rg.Polyline(new_polyline_transformed).ToNurbsCurve()
    # point_start = list(new_polyline.GetEnumerator())[-1]
    # point_end = list(new_polyline_transformed.GetEnumerator())[-1]
    breps = rg.Brep.CreateFromLoft([curve1, curve2], rg.Point3d.Unset ,rg.Point3d.Unset, rg.LoftType(3), False)
    brep = breps[0]
    brep.CapPlanarHoles(1)
    # meshes = rg.Mesh.CreateFromBrep(brep,rg.MeshingParameters.Default)
    # mesh = meshes[0]
    subd = rg.SubD.CreateFromLoft([curve1, curve2],False,False,False,3)
    mesh = rg.Mesh.CreateFromSubDControlNet(subd)
    rg.Mesh.FillHoles(mesh)
    mesh.MergeAllCoplanarFaces(1.0)
    subd_closed = rg.SubD.CreateFromMesh(mesh)

    return mesh
    # return curve1


center_point = rg.Point3d(0, 0, 0)

mesh = to_top_geometry(center_point, radius,scale,height,parameter)
# ---------- end script_3 ----------
mesh = Mesh(script_3.mesh)

# ----
# parametric mesh
script_4 = Script(radius=radius, scale=scale, height=height_2)  # -> out, mesh
# ---------- script_4: Python ----------
import Rhino.Geometry as rg
import ghpythonlib.components as gh


def to_top_geometry(center_point, radius, scale, height):
    # Create a regular hexagon with the specified center point and radius
    circle = rg.Circle(center_point , radius)
    hexagon = rg.Polyline.CreateInscribedPolygon(circle,6)
    points_to_move = []
    points_to_move = list(hexagon.GetEnumerator())[4:6]
    distance_to_move = 1.27 * radius
    for point in points_to_move:
        point.Transform(rg.Transform.Translation(0, -distance_to_move, 0))
    #new polyline
    new_points =[]
    new_points.extend(list(hexagon.GetEnumerator())[0:4])
    new_points.extend(points_to_move)
    new_points.extend(list(hexagon.GetEnumerator())[6:])
    new_polyline = rg.Polyline(new_points)
    #find the center point get upper polyline
    new_polyline_transformed = rg.Polyline.Duplicate(new_polyline)
    center_point = rg.Polyline.CenterPoint(new_polyline)
    new_polyline_transformed.Transform(rg.Transform.Scale(center_point,scale))
    new_polyline_transformed.Transform(rg.Transform.Translation(0,0,height))
    #loft geometry and close it
    curve1 = rg.Polyline(new_polyline).ToNurbsCurve()
    curve2 = rg.Polyline(new_polyline_transformed).ToNurbsCurve()
    # point_start = list(new_polyline.GetEnumerator())[-1]
    # point_end = list(new_polyline_transformed.GetEnumerator())[-1]
    breps = rg.Brep.CreateFromLoft([curve1, curve2], rg.Point3d.Unset ,rg.Point3d.Unset, rg.LoftType(3), False)
    brep = breps[0]
    brep.CapPlanarHoles(1)
    # meshes = rg.Mesh.CreateFromBrep(brep,rg.MeshingParameters.Default)
    # mesh = meshes[0]
    subd = rg.SubD.CreateFromLoft([curve1, curve2],False,False,False,3)
    mesh = rg.Mesh.CreateFromSubDControlNet(subd)
    rg.Mesh.FillHoles(mesh)
    mesh.MergeAllCoplanarFaces(1.0)
    subd_closed = rg.SubD.CreateFromMesh(mesh)

    return mesh
    # return curve1


center_point = rg.Point3d(0, 0, 0)

mesh =  to_top_geometry(center_point, radius,scale,height)
# ---------- end script_4 ----------
mesh_2 = Mesh(script_4.mesh)

script_5 = Script(
    tile_size=number_slider_2,
    ribs_number=Slider(8, range=0..10),
    depth01=Slider(26, range=0..100),
    depth02=Slider(58, range=0..100),
    depth03=Slider(30, range=0..100),
    rib_middle_parameter=number_slider_3)  # -> out, a; inputs ribs_number: Int32
# ---------- script_5: Python ----------
import Rhino.Geometry as rg

def folds_geometry(tile_size, ribs_number, depth01, depth02, depth03, rib_middle_parameter, point):
    # moved_point = rg.Point3d.Add(point, rg.Vector3d(0, depth01, 0))
    middle_point = rg.Point3d.Add(point, rg.Vector3d(0, 0, rib_middle_parameter * tile_size))
    top_point = rg.Point3d.Add(point, rg.Vector3d(0, 0, tile_size))
    step_size = tile_size / (ribs_number * 2 )

    #pointslist
    points_list =  []
    points_list.append(point)
    for i in range(ribs_number * 2):
        new_point = rg.Point3d(point.X+ (i + 1) * step_size, point.Y , point.Z)
        points_list.append(new_point)
    # points_list.append(rg.Point3d(point.X + tile_size , point.Y , point.Z))
    for i,point in enumerate(points_list):
        if i%2 != 0:
            point.Transform(rg.Transform.Translation(0,-depth01,0))
    polyline01 = rg.Polyline(points_list)
    curve01 = rg.Polyline(polyline01).ToNurbsCurve()


    #middle points list
    middle_points_list =  []
    middle_points_list.append(middle_point)
    for i in range(ribs_number * 2):
        new_point = rg.Point3d(middle_point.X+ (i + 1) * step_size, middle_point.Y , middle_point.Z)
        middle_points_list.append(new_point)
    for i,point in enumerate(middle_points_list):
        if i%2 != 0:
            point.Transform(rg.Transform.Translation(0,-depth02,0))
    polyline02 = rg.Polyline(middle_points_list)
    curve02 = rg.Polyline(polyline02).ToNurbsCurve()

    #top points list
    top_points_list = []
    top_points_list.append(top_point)
    for i in range(ribs_number * 2):
        new_point = rg.Point3d(top_point.X + (i + 1) * step_size, top_point.Y , top_point.Z)
        top_points_list.append(new_point)
    for i , point in enumerate(top_points_list):
        if i%2 != 0:
            point.Transform(rg.Transform.Translation(0,-depth03,0))
    polyline03 = rg.Polyline(top_points_list)
    curve03 = rg.Polyline(polyline03).ToNurbsCurve()

    breps = rg.Brep.CreateFromLoft([curve01, curve02, curve03], rg.Point3d.Unset ,rg.Point3d.Unset, rg.LoftType(3), False)

    return breps[0]





point = rg.Point3d(0,0,0)
a = []
a .append(folds_geometry(tile_size, ribs_number, depth01, depth02, depth03, rib_middle_parameter, point))
# ---------- end script_5 ----------
list_item = ListItem(List=ghpython_script.a, Index=0, Wrap=True)
script_6 = Script(
    tile_size=Slider(200, range=0..1000),
    ribs_number01=Slider(8, range=0..10),
    ribs_number03=Slider(7, range=0..10),
    depth01=Slider(16, range=0..100),
    depth03=Slider(20, range=0..100))  # -> out, a; inputs ribs_number01: Int32, ribs_number03: Int32
# ---------- script_6: Python ----------
import Rhino.Geometry as rg

def folds_geometry(tile_size, ribs_number01,ribs_number02,ribs_number03, depth01, depth02, depth03, rib_middle_parameter, point):
    # moved_point = rg.Point3d.Add(point, rg.Vector3d(0, depth01, 0))
    middle_point = rg.Point3d.Add(point, rg.Vector3d(0, 0, rib_middle_parameter * tile_size))
    top_point = rg.Point3d.Add(point, rg.Vector3d(0, 0, tile_size))
    

    #pointslist
    points_list =  []
    step_size01 = tile_size / (ribs_number01 * 2 )
    points_list.append(point)
    for i in range(ribs_number01 * 2):
        new_point = rg.Point3d(point.X+ (i + 1) * step_size01, point.Y , point.Z)
        points_list.append(new_point)
    # points_list.append(rg.Point3d(point.X + tile_size , point.Y , point.Z))
    for i,p in enumerate(points_list):
        if i%2 != 0 and i!=0 and i!=len(points_list)-1:
            p.Transform(rg.Transform.Translation(0,-depth01,0))
        if i%2 == 0 and i!=len(points_list)-1 and i!=0:
            p.Transform(rg.Transform.Translation(0,depth01,0))
    # points_list[0] = point
    # points_list[-1] = rg.Point3d(point.X+ (i + 1) * step_size01, point.Y , point.Z)
    polyline01 = rg.Polyline(points_list)
    curve01 = rg.Curve.CreateInterpolatedCurve(points_list,3,rg.CurveKnotStyle.Uniform)
    # curve01 = rg.Polyline(polyline01).ToNurbsCurve()


    #middle points list
    middle_points_list =  []
    step_size02 = tile_size / (ribs_number02 * 2 )
    middle_points_list.append(middle_point)
    for i in range(ribs_number02 * 2):
        new_point = rg.Point3d(middle_point.X+ (i + 1) * step_size02, middle_point.Y , middle_point.Z)
        middle_points_list.append(new_point)
    # points_list.append(rg.Point3d(point.X + tile_size , point.Y , point.Z))
    for i,p in enumerate(middle_points_list):
        if i%2 != 0 and i!=0 and i!=len(middle_points_list)-1:
            p.Transform(rg.Transform.Translation(0,-depth02,0))
        if i%2 == 0 and i!=len(middle_points_list)-1 and i!=0:
            p.Transform(rg.Transform.Translation(0,depth02,0))
    polyline02 = rg.Polyline(middle_points_list)
    curve02 = rg.Curve.CreateInterpolatedCurve(middle_points_list,3,rg.CurveKnotStyle.Uniform)


    #top points list
    top_points_list = []
    step_size03 = tile_size / (ribs_number03 * 2 )
    top_points_list.append(top_point)
    for i in range(ribs_number03 * 2):
        new_point = rg.Point3d(top_point.X+ (i + 1) * step_size03, top_point.Y , top_point.Z)
        top_points_list.append(new_point)
    # points_list.append(rg.Point3d(point.X + tile_size , point.Y , point.Z))
    for i,p in enumerate(top_points_list):
        if i%2 != 0 and i!=0 and i!=len(top_points_list)-1:
            p.Transform(rg.Transform.Translation(0,-depth03,0))
        if i%2 == 0 and i!=len(top_points_list)-1 and i!=0:
            p.Transform(rg.Transform.Translation(0,depth03,0))
    polyline03 = rg.Polyline(top_points_list)
    curve03 = rg.Curve.CreateInterpolatedCurve(top_points_list,3,rg.CurveKnotStyle.Uniform)    
    

    breps = rg.Brep.CreateFromLoft([curve01, curve03], rg.Point3d.Unset ,rg.Point3d.Unset, rg.LoftType(3), False)

    return breps[0]



rib_middle_parameter = 0.5
ribs_number02 = 8
point = rg.Point3d(0,0,0)
a = []
depth02 = 20
a .append(folds_geometry(tile_size,ribs_number01,ribs_number02,ribs_number03, depth01, depth02, depth03, rib_middle_parameter, point))
# ---------- end script_6 ----------

# ----
# parametric mesh
number_slider_5 = Slider(40, range=0..100)
script_7 = Script(boundary=list_item, scale=Slider(0.18, range=0..1), height=number_slider_5)  # -> out, mesh
# ---------- script_7: Python ----------
import Rhino.Geometry as rg



def to_top_geometry(boundary, scale, height):
    polylinecurve = boundary.ToPolyline(0.5,0.1,0.1,500)
    polyline = polylinecurve.ToPolyline()
    new_points = []
    # list(polyline.GetEnumerator())
    for i in range(0, polyline.Count, 2):
        new_points.append(polyline[i])
    new_polyline = rg.Polyline(new_points)
        # new_polyline = quadrilateral
    new_polyline = rg.Polyline(new_points)
    # c = rg.Polyline(new_polyline).ToNurbsCurve()

    #find the center point get upper polyline
    new_polyline_transformed = rg.Polyline.Duplicate(new_polyline)
    center_point = rg.Polyline.CenterPoint(new_polyline)
    new_polyline_transformed.Transform(rg.Transform.Scale(center_point,scale))
    new_polyline_transformed.Transform(rg.Transform.Translation(0,0,height))
    #loft geometry and close it
    curve1 = rg.Polyline(new_polyline).ToNurbsCurve()
    curve2 = rg.Polyline(new_polyline_transformed).ToNurbsCurve()
    # point_start = list(new_polyline.GetEnumerator())[-1]
    # point_end = list(new_polyline_transformed.GetEnumerator())[-1]
    breps = rg.Brep.CreateFromLoft([curve1, curve2], rg.Point3d.Unset ,rg.Point3d.Unset, rg.LoftType(3), False)
    brep = breps[0]
    brep.CapPlanarHoles(1)
    # meshes = rg.Mesh.CreateFromBrep(brep,rg.MeshingParameters.Default)
    # mesh = meshes[0]
    subd = rg.SubD.CreateFromLoft([curve1, curve2],False,False,False,3)
    mesh = rg.Mesh.CreateFromSubDControlNet(subd)
    rg.Mesh.FillHoles(mesh)
    mesh.MergeAllCoplanarFaces(1.0)
    subd_closed = rg.SubD.CreateFromMesh(mesh)

    return mesh
    




scale = 0.26
height = 40
mesh = to_top_geometry(boundary, scale, height)
# ---------- end script_7 ----------

# ----
# mesh to subD
subd_from_mesh = SubDFromMesh(Mesh=script.a, Creases=2, Corners=1, Interpolate=False)

# ----
# Front Geometry
# mesh to subD
subd_from_mesh_2 = SubDFromMesh(Mesh=mesh_2, Creases=2, Corners=1, Interpolate=False)
subd = SubD(subd_from_mesh_2)

# ----
# Front Geometry
# mesh to subD
subd_from_mesh_3 = SubDFromMesh(Mesh=mesh, Creases=2, Corners=1, Interpolate=False)
subd_2 = SubD(subd_from_mesh_3)

# ----
# final subd
script_8 = Script(subd=subd_from_mesh, distance=distance_to_move, divisions=divisions, tile_size=tile_size, thickness=thickness)  # -> out, a; inputs divisions: Int32
# ---------- script_8: Python ----------
import Rhino.Geometry as rg
import math

def Points_to_move(subd,distance,point,length):
    vertices = subd.Vertices
    vertices_list= []
    for i in range(1,vertices.Count+1):
        vertices_list.append(vertices.Find(i))
    # #visualisation
    # visualisation=[]
    # for v in vertices_list:
    #     visualisation.append(rg.SubDVertex.SurfacePoint(v))    

 # id of vertices to move
    points_inmiddle_list_visualisation =[]
    points_inmiddle_list =[]
    points_inmiddle_list_id =[]
    for vertex in vertices_list:
        v = rg.SubDVertex.SurfacePoint(vertex)
        if v.Y > float(point.Y + width) -1:
            # index_list.append(v)
            if point.X+0.1 < v.X < point.X+ length-0.1:
                # index_list.append(v)
                if point.Z+0.1 < v.Z < point.Z+ length-0.1:
                    points_inmiddle_list.append(vertex)
                    points_inmiddle_list_id.append(vertex.Id)
                    points_inmiddle_list_visualisation.append(v)

    index_list =[]
    points_inmiddle_list_half = points_inmiddle_list[::2]
    points_inmiddle_list_half_id = points_inmiddle_list_id[::2]
    points_inmiddle_list_half_half = []
    points_inmiddle_list_half_half_id = []
    for i in range(0, len(points_inmiddle_list_half), divisions-1):
        points_inmiddle_list_half_half.extend(points_inmiddle_list_half[i:i + divisions // 2])
        points_inmiddle_list_half_half_id.extend(points_inmiddle_list_half_id[i:i + divisions // 2])

    current_locations=[]
    for index in points_inmiddle_list_half_half_id:
        points_to_move = vertices.Find(index)
        current_location = points_to_move.ControlNetPoint
        current_locations.append(current_location)
        new_location = rg.Point3d(current_location.X, current_location.Y + distance, current_location.Z)
        points_to_move.ControlNetPoint = new_location


    # for vertex in vertices:
    #     a.append(rg.SubDVertex.SurfacePoint)
    return subd
length = height=tile_size
width =thickness
point= rg.Point3d(0,0,0)
a = Points_to_move(subd,distance,point,length)
# ---------- end script_8 ----------

geometry = Geometry(script_6.a)

# ----
# subD crease
script_9 = Script(subD=subd)  # -> out, ids
# ---------- script_9: Python ----------
import Rhino.Geometry as rg
def subd_in_python(subd):
        #get edges and ids
    edges = subd.Edges
    ids =[]
    for edge in edges:
        ids.append(edge.Id)
    #get index of crease
    list_length = len(ids)
    list1 = list(range(list_length))  # 包含从0到17的所有整数的列表
    list2 = [0,1,2,3,4,5,6,7,8,9,10,11]  #剪掉不需要crease的边
    # list2 = [5]
    index = [x for x in list1 if x not in list2]
    edges_to_crease=[]
    edges_to_crease_nurbscurve=[]
    ids_to_crease = []
    for i, edge in enumerate(edges):
        if i in index:
            edge.Tag = rg.SubDEdgeTag.Crease
            edges_to_crease.append(edge)
            ids_to_crease.append(edge.Id)
            edges_to_crease_nurbscurve.append(edge.ToNurbsCurve(False))
    return ids_to_crease

ids = subd_in_python(subD)
# ---------- end script_9 ----------
subd_edge_tags = SubDEdgeTags(SubD=subd_from_mesh_2, EdgeTag="smooth", EdgeIDs=script_9.ids)

# ----
# subD crease
script_10 = Script(subD=subd_2)  # -> out, ids
# ---------- script_10: Python ----------
import Rhino.Geometry as rg
def subd_in_python(subd):
        #get edges and ids
    edges = subd.Edges
    ids =[]
    for edge in edges:
        ids.append(edge.Id)
    #get index of crease
    list_length = len(ids)
    list1 = list(range(list_length))  # 包含从0到17的所有整数的列表
    list2 = [0,1,2,3,4,5,6,7]  #剪掉不需要crease的边
    # list2 = [5]
    index = [x for x in list1 if x not in list2]
    edges_to_crease=[]
    edges_to_crease_nurbscurve=[]
    ids_to_crease = []
    for i, edge in enumerate(edges):
        if i in index:
            edge.Tag = rg.SubDEdgeTag.Crease
            edges_to_crease.append(edge)
            ids_to_crease.append(edge.Id)
            edges_to_crease_nurbscurve.append(edge.ToNurbsCurve(False))
    return ids_to_crease

ids = subd_in_python(subD)
# ---------- end script_10 ----------
subd_edge_tags_2 = SubDEdgeTags(SubD=subd_from_mesh_3, EdgeTag="smooth", EdgeIDs=script_10.ids)

# ----
# mesh to subD
subd_from_mesh_4 = SubDFromMesh(Mesh=script_7.mesh, Creases=2, Corners=1, Interpolate=False)
subd_3 = SubD(subd_from_mesh_4)

subd_4 = SubD(subd_edge_tags)
subd_5 = SubD(subd_edge_tags_2)

# ----
# subD crease
script_11 = Script(subD=subd_3)  # -> out, ids
# ---------- script_11: Python ----------
import Rhino.Geometry as rg
def subd_in_python(subd):
        #get edges and ids
    edges = subd.Edges
    ids =[]
    for edge in edges:
        ids.append(edge.Id)
    #get index of crease
    list_length = len(ids)
    list1 = list(range(list_length))  # 包含从0到17的所有整数的列表
    list2 = [0,1,2,3,4,5,6,7,8,9]  #剪掉不需要crease的边
    # list2 = [5]
    index = [x for x in list1 if x not in list2]
    edges_to_crease=[]
    edges_to_crease_nurbscurve=[]
    ids_to_crease = []
    for i, edge in enumerate(edges):
        if i in index:
            edge.Tag = rg.SubDEdgeTag.Crease
            edges_to_crease.append(edge)
            ids_to_crease.append(edge.Id)
            edges_to_crease_nurbscurve.append(edge.ToNurbsCurve(False))
    return ids_to_crease

ids = subd_in_python(subD)
# ---------- end script_11 ----------
subd_edge_tags_3 = SubDEdgeTags(SubD=subd_3, EdgeTag="smooth", EdgeIDs=script_11.ids)

subd_6 = SubD(subd_edge_tags_3)
